# Grasshopper definition roslibpy.gh (Grasshopper 1.0.7)

pt = ConstructPoint(XCoordinate=Slider(841, range=0..10000), YCoordinate=0, ZCoordinate=Slider(253, range=0..1000))

# ---- group: Connect ROS client
# roslibpy
toggle = BooleanToggle(True)
python = GhPythonScript(connect=toggle, ip="192.168.1.1")  # -> out, client; inputs connect: Boolean
# ---------- python: Python ----------
# inputs > name/typehint/access 
#   > connect/bool/item
#   > ip/str/item
# output
#   > client/roslibpy.Ros

import rhinoscriptsyntax as rs
import roslibpy

if connect:
    c = roslibpy.Ros(host=ip, port=9090)
    c.run()
    print 'client connected %s' % c.is_connected
    client = c
# ---------- end python ----------

# ----
number_slider = Slider(1661, range=0..10000)
polygon = Polygon(Plane=pt, Radius=Slider(216, range=0..1000), Segments=6, FilletRadius=0)  # -> Polygon, Length
divide = DivideCurve(Curve=polygon.Polygon, Count=1, Kinks=True)  # -> Points, Tangents, Parameters
pt_2 = ConstructPoint(XCoordinate=number_slider, YCoordinate=number_slider, ZCoordinate=0)
panel = Panel(python.out)
trigger = Trigger(Interval=1000, TimerInterval=1000, Target=publish_pose)
trigger_2 = Trigger(Interval=20, TimerInterval=20, Target=publish_pose_array)  # disabled
set = Button()
pl = ConstructPlane(Origin=divide.Points, XAxis=expr("-x", Vector(1, 0, 0)), YAxis=Vector(0, 1, 0))
xy = XYPlane(Origin=Point(0, 0, 0))
xy_2 = XYPlane(Origin=Point(0, 0, 0))
xy_3 = XYPlane(Origin=pt_2)
xy_4 = XYPlane(Origin=Point(0, 0, 0))

# ---- group: publish pose array
publish_pose_array = GhPythonScript(client=python.client, topic="/gh_client_pose_array", origin=xy_4, planes=pl)  # -> out; inputs origin: Plane, planes: list of Plane
# ---------- publish_pose_array: Python ----------
# inputs > name/typehint/access 
#   > client/roslibpy.ROS/item
#   > topic/str/item
#   > origin/plane/item
#   > planes/plane/tree 

import rhinoscriptsyntax as rs
import Rhino.Geometry as rg
import math
import roslibpy

def publish_pose_array():
    pose_pub = roslibpy.Topic(
        client, topic, 'geometry_msgs/PoseArray')
    if client is None:
        print 'Client is not connected'
        return
    if client.is_connected:
        pose_pub.publish(roslibpy.Message({'header':roslibpy.Header(seq=0,
                                                                    stamp=roslibpy.Time.now(),
                                                                    frame_id='base_link'),
                                            'poses': load_poses()}))
    else:
        print('client is not connected')

def load_poses():
    poses = []
    for plane in planes:
        pose = plane_to_pose(origin, plane)
        pose ={'position': {'x': pose[0], 'y': pose[1], 'z': pose[2]},
                'orientation': {'w': pose[3], 'x': pose[4], 'y': pose[5],'z': pose[6]}}
        poses.append(pose)
        print pose
    return poses

def plane_to_pose(frame_origin, frame):

    matrix = rg.Transform.PlaneToPlane(frame_origin, frame).Transpose()
    trace = matrix.M00 + matrix.M11 + matrix.M22

    q = rg.Quaternion()

    if trace > 0.0:
        s = math.sqrt(trace + 1.0)
        q.A = s * 0.5
        s = 0.5 / s
        q.B = (matrix.M12 - matrix.M21) * s
        q.C = (matrix.M20 - matrix.M02) * s
        q.D = (matrix.M01 - matrix.M10) * s
    else:
        if matrix.M00 >= matrix.M11 and matrix.M00 >= matrix.M22:
            s = math.sqrt(1.0 + matrix.M00 - matrix.M11 - matrix.M22)
            inv_s = 0.5 / s
            q.B = 0.5 * s
            q.C = (matrix.M01 + matrix.M10) * inv_s
            q.D = (matrix.M02 + matrix.M20) * inv_s
            q.A = (matrix.M12 - matrix.M21) * inv_s
        elif matrix.M11 > matrix.M22:
            s = math.sqrt(1.0 + matrix.M11 - matrix.M00 - matrix.M22)
            inv_s = 0.5 / s
            q.B = (matrix.M10 + matrix.M01) * inv_s
            q.C = 0.5 * s
            q.D = (matrix.M21 + matrix.M12) * inv_s
            q.A = (matrix.M20 - matrix.M02) * inv_s
        else:
            s = math.sqrt(1.0 + matrix.M22 - matrix.M00 - matrix.M11)
            inv_s = 0.5 / s
            q.B = (matrix.M20 + matrix.M02) * inv_s
            q.C = (matrix.M21 + matrix.M12) * inv_s
            q.D = 0.5 * s
            q.A = (matrix.M01 - matrix.M10) * inv_s
            
        

    return [frame.OriginX/1000, frame.OriginY/1000, frame.OriginZ/1000, q.A, q.B, q.C, q.D]

publish_pose_array()
# ---------- end publish_pose_array ----------

# ---- group: set ROS param
python_2 = GhPythonScript(client=python.client, param_name="gh_poses", set_param=set, origin=xy, planes=pl)  # -> out, a; inputs set_param: Boolean, origin: Plane, planes: list of Plane
# ---------- python_2: Python ----------
# inputs > name/typehint/access 
#   > client/roslibpy.ROS/item
#   > param name/str/item
#   > origin/plane/item
#   > planes/plane/tree 


import rhinoscriptsyntax as rs
import Rhino.Geometry as rg
import roslibpy
import math

def plane_to_pose(frame_origin, frame):

    matrix = rg.Transform.PlaneToPlane(frame_origin, frame).Transpose()
    trace = matrix.M00 + matrix.M11 + matrix.M22

    q = rg.Quaternion()

    if trace > 0.0:
        s = math.sqrt(trace + 1.0)
        q.A = s * 0.5
        s = 0.5 / s
        q.B = (matrix.M12 - matrix.M21) * s
        q.C = (matrix.M20 - matrix.M02) * s
        q.D = (matrix.M01 - matrix.M10) * s
    else:
        if matrix.M00 >= matrix.M11 and matrix.M00 >= matrix.M22:
            s = math.sqrt(1.0 + matrix.M00 - matrix.M11 - matrix.M22)
            inv_s = 0.5 / s
            q.B = 0.5 * s
            q.C = (matrix.M01 + matrix.M10) * inv_s
            q.D = (matrix.M02 + matrix.M20) * inv_s
            q.A = (matrix.M12 - matrix.M21) * inv_s
        elif matrix.M11 > matrix.M22:
            s = math.sqrt(1.0 + matrix.M11 - matrix.M00 - matrix.M22)
            inv_s = 0.5 / s
            q.B = (matrix.M10 + matrix.M01) * inv_s
            q.C = 0.5 * s
            q.D = (matrix.M21 + matrix.M12) * inv_s
            q.A = (matrix.M20 - matrix.M02) * inv_s
        else:
            s = math.sqrt(1.0 + matrix.M22 - matrix.M00 - matrix.M11)
            inv_s = 0.5 / s
            q.B = (matrix.M20 + matrix.M02) * inv_s
            q.C = (matrix.M21 + matrix.M12) * inv_s
            q.D = 0.5 * s
            q.A = (matrix.M01 - matrix.M10) * inv_s
    
    frame.Origin = frame.Origin - frame_origin.Origin 

    return [frame.OriginX/1000, frame.OriginY/1000, frame.OriginZ/1000, q.B, q.C, q.D, q.A]

def main():
    if set:
        if client is None:
            print 'Client is not connected'
            return
        poses = []
        for plane in planes:
            pose = plane_to_pose(origin, plane)
            poses.append(pose)
            print pose
        if client.is_connected:
            roslibpy.Param(client,'gh_poses').set(poses)
        else:
            print 'client is not connected'

main()
# ---------- end python_2 ----------

# ---- group: publish pose
publish_pose = GhPythonScript(client=python.client, topic="/gh_client_pose", origin=xy_2, plane=xy_3)  # -> out; inputs origin: Plane, plane: Plane
# ---------- publish_pose: Python ----------
# inputs > name/typehint/access 
#   > client/roslibpy.ROS/item
#   > param name/str/item
#   > origin/plane/item
#   > planes/plane/tree 

import math
import rhinoscriptsyntax as rs
import Rhino.Geometry as rg
import roslibpy

def publish_pose(pose):
    pose_pub = roslibpy.Topic(
        client, topic, 'geometry_msgs/Pose')
    if client is None:
        print'Client is not connected'
        return
    if client.is_connected:
        pose_pub.publish(roslibpy.Message({'position': {'x': pose[0], 'y': pose[1], 'z': pose[2]}, 'orientation': {
                         'w': pose[3], 'x': pose[4], 'y': pose[5], 'z': pose[6]}}))
    else:
        print('client is not connected')

def plane_to_pose(frame_origin, frame):

    matrix = rg.Transform.PlaneToPlane(frame_origin, frame).Transpose()
    trace = matrix.M00 + matrix.M11 + matrix.M22

    q = rg.Quaternion()

    if trace > 0.0:
        s = math.sqrt(trace + 1.0)
        q.A = s * 0.5
        s = 0.5 / s
        q.B = (matrix.M12 - matrix.M21) * s
        q.C = (matrix.M20 - matrix.M02) * s
        q.D = (matrix.M01 - matrix.M10) * s
    else:
        if matrix.M00 >= matrix.M11 and matrix.M00 >= matrix.M22:
            s = math.sqrt(1.0 + matrix.M00 - matrix.M11 - matrix.M22)
            inv_s = 0.5 / s
            q.B = 0.5 * s
            q.C = (matrix.M01 + matrix.M10) * inv_s
            q.D = (matrix.M02 + matrix.M20) * inv_s
            q.A = (matrix.M12 - matrix.M21) * inv_s
        elif matrix.M11 > matrix.M22:
            s = math.sqrt(1.0 + matrix.M11 - matrix.M00 - matrix.M22)
            inv_s = 0.5 / s
            q.B = (matrix.M10 + matrix.M01) * inv_s
            q.C = 0.5 * s
            q.D = (matrix.M21 + matrix.M12) * inv_s
            q.A = (matrix.M20 - matrix.M02) * inv_s
        else:
            s = math.sqrt(1.0 + matrix.M22 - matrix.M00 - matrix.M11)
            inv_s = 0.5 / s
            q.B = (matrix.M20 + matrix.M02) * inv_s
            q.C = (matrix.M21 + matrix.M12) * inv_s
            q.D = 0.5 * s
            q.A = (matrix.M01 - matrix.M10) * inv_s

    return [frame.OriginX/1000, frame.OriginY/1000, frame.OriginZ/1000, q.A, q.B, q.C, q.D]

publish_pose(plane_to_pose(origin,plane))
# ---------- end publish_pose ----------

# ----
panel_2 = Panel(publish_pose)
