# Grasshopper definition roslibpy_examples.gh (Grasshopper 1.0.7)

# ---- group: Connect ROS client
python = GhPythonScript(connect=Toggle(True), ip="192.168.1.1")  # -> out, client; inputs connect: Boolean
# ---------- python: Python ----------
__author__ = "vince"
__version__ = "2022.11.04"

import rhinoscriptsyntax as rs
import roslibpy

if connect:
    c = roslibpy.Ros(host=ip, port=9090)
    c.run()
    print 'client connected %s' % c.is_connected
    client = c
# ---------- end python ----------

# ----
panel = Panel(python.out)
pt = ConstructPoint(XCoordinate=Slider(2095, range=0..10000), YCoordinate=0, ZCoordinate=Slider(1000, range=0..1000))
pt_2 = ConstructPoint(XCoordinate=Slider(1300, range=0..10000), YCoordinate=0, ZCoordinate=Slider(500, range=0..1000))
number_slider = Slider(3701, range=0..10000)
polygon = Polygon(Plane=pt, Radius=Slider(464, range=0..1000), Segments=6, FilletRadius=0)  # -> Polygon, Length
polygon_2 = Polygon(Plane=pt_2, Radius=Slider(300, range=0..1000), Segments=Slider(6, range=0..10), FilletRadius=0)  # -> Polygon, Length
divide = DivideCurve(Curve=polygon.Polygon, Count=1, Kinks=True)  # -> Points, Tangents, Parameters
divide_2 = DivideCurve(Curve=polygon_2.Polygon, Count=1, Kinks=True)  # -> Points, Tangents, Parameters
pt_3 = ConstructPoint(XCoordinate=number_slider, YCoordinate=number_slider, ZCoordinate=0)
trigger = Trigger(Interval=1000, TimerInterval=1000, Target=publish_pose)  # disabled
trigger_2 = Trigger(Interval=1000, TimerInterval=1000, Target=publish_pose_array)  # disabled
xy = XYPlane(Origin=divide_2.Points)
xy_2 = XYPlane(Origin=Point(0, 0, 0))
xy_3 = XYPlane(Origin=pt_3)
xy_4 = XYPlane(Origin=Point(0, 0, 0))
xy_5 = XYPlane(Origin=divide.Points)

# ---- group: publish pose array
publish_pose_array = GhPythonScript(client=python.client, topic="/gh_client_pose_array", origin=xy_4, planes=xy_5)  # -> out; inputs origin: Plane, planes: list of Plane
# ---------- publish_pose_array: Python ----------
import rhinoscriptsyntax as rs
import Rhino.Geometry as rg
import math
import roslibpy

def publish_pose_array():
    pose_pub = roslibpy.Topic(
        client, topic, 'geometry_msgs/PoseArray')

    if client.is_connected:
        pose_pub.publish(roslibpy.Message({'header':roslibpy.Header(seq=0,
                                                                    stamp=roslibpy.Time.now(),
                                                                    frame_id='base_link'),
                                            'poses': load_poses()}))
    else:
        print('client is not connected')

def load_poses():
    poses = []
    for plane in planes:
        pose = plane_to_pose(origin, plane)
        pose ={'position': {'x': pose[0], 'y': pose[1], 'z': pose[2]},
                'orientation': {'x': pose[3], 'y': pose[4], 'z': pose[5]}}
        poses.append(pose)
    return poses

def plane_to_pose(frame_origin, frame):

    matrix = rg.Transform.PlaneToPlane(frame_origin, frame).Transpose()
    trace = matrix.M00 + matrix.M11 + matrix.M22

    q = rg.Quaternion()

    if trace > 0.0:
        s = math.sqrt(trace + 1.0)
        q.A = s * 0.5
        s = 0.5 / s
        q.B = (matrix.M12 - matrix.M21) * s
        q.C = (matrix.M20 - matrix.M02) * s
        q.D = (matrix.M01 - matrix.M10) * s
    else:
        if matrix.M00 >= matrix.M11 and matrix.M00 >= matrix.M22:
            s = math.sqrt(1.0 + matrix.M00 - matrix.M11 - matrix.M22)
            inv_s = 0.5 / s
            q.B = 0.5 * s
            q.C = (matrix.M01 + matrix.M10) * inv_s
            q.D = (matrix.M02 + matrix.M20) * inv_s
            q.A = (matrix.M12 - matrix.M21) * inv_s
        elif matrix.M11 > matrix.M22:
            s = math.sqrt(1.0 + matrix.M11 - matrix.M00 - matrix.M22)
            inv_s = 0.5 / s
            q.B = (matrix.M10 + matrix.M01) * inv_s
            q.C = 0.5 * s
            q.D = (matrix.M21 + matrix.M12) * inv_s
            q.A = (matrix.M20 - matrix.M02) * inv_s
        else:
            s = math.sqrt(1.0 + matrix.M22 - matrix.M00 - matrix.M11)
            inv_s = 0.5 / s
            q.B = (matrix.M20 + matrix.M02) * inv_s
            q.C = (matrix.M21 + matrix.M12) * inv_s
            q.D = 0.5 * s
            q.A = (matrix.M01 - matrix.M10) * inv_s

    return [frame.OriginX/1000, frame.OriginY/1000, frame.OriginZ/1000, q.A, q.B, q.C, q.D]

publish_pose_array()
# ---------- end publish_pose_array ----------

# ---- group: set ROS param
python_2 = GhPythonScript(client=python.client, param_name="gh_poses", set_param=Button(), origin=xy_4, planes=xy)  # -> out, a; inputs set_param: Boolean, origin: Plane, planes: list of Plane
# ---------- python_2: Python ----------
__author__ = "vince"
__version__ = "2022.11.04"

import rhinoscriptsyntax as rs
import Rhino.Geometry as rg
import roslibpy
import math

def plane_to_pose(frame_origin, frame):

    matrix = rg.Transform.PlaneToPlane(frame_origin, frame).Transpose()
    trace = matrix.M00 + matrix.M11 + matrix.M22

    q = rg.Quaternion()

    if trace > 0.0:
        s = math.sqrt(trace + 1.0)
        q.A = s * 0.5
        s = 0.5 / s
        q.B = (matrix.M12 - matrix.M21) * s
        q.C = (matrix.M20 - matrix.M02) * s
        q.D = (matrix.M01 - matrix.M10) * s
    else:
        if matrix.M00 >= matrix.M11 and matrix.M00 >= matrix.M22:
            s = math.sqrt(1.0 + matrix.M00 - matrix.M11 - matrix.M22)
            inv_s = 0.5 / s
            q.B = 0.5 * s
            q.C = (matrix.M01 + matrix.M10) * inv_s
            q.D = (matrix.M02 + matrix.M20) * inv_s
            q.A = (matrix.M12 - matrix.M21) * inv_s
        elif matrix.M11 > matrix.M22:
            s = math.sqrt(1.0 + matrix.M11 - matrix.M00 - matrix.M22)
            inv_s = 0.5 / s
            q.B = (matrix.M10 + matrix.M01) * inv_s
            q.C = 0.5 * s
            q.D = (matrix.M21 + matrix.M12) * inv_s
            q.A = (matrix.M20 - matrix.M02) * inv_s
        else:
            s = math.sqrt(1.0 + matrix.M22 - matrix.M00 - matrix.M11)
            inv_s = 0.5 / s
            q.B = (matrix.M20 + matrix.M02) * inv_s
            q.C = (matrix.M21 + matrix.M12) * inv_s
            q.D = 0.5 * s
            q.A = (matrix.M01 - matrix.M10) * inv_s

    return [frame.OriginX/1000, frame.OriginY/1000, frame.OriginZ/1000, q.A, q.B, q.C, q.D]

if set:
    poses = []
    for plane in planes:
        pose = plane_to_pose(origin, plane)
        poses.append(pose)
    if client.is_connected:
        roslibpy.Param(client,'gh_poses').set(poses)
    else:
        print 'client is not connected'
# ---------- end python_2 ----------

# ---- group: publish pose
publish_pose = GhPythonScript(client=python.client, topic="/gh_client_pose", origin=xy_2, plane=xy_3)  # -> out; inputs origin: Plane, plane: Plane; disabled
# ---------- publish_pose: Python ----------
import rhinoscriptsyntax as rs
import Rhino.Geometry as rg
import math
import roslibpy

def publish_pose(pose):
    pose_pub = roslibpy.Topic(
        client, topic, 'geometry_msgs/Pose')

    if client.is_connected:
        pose_pub.publish(roslibpy.Message({'position': {'x': pose[0], 'y': pose[1], 'z': pose[2]}, 'orientation': {
                         'x': pose[3], 'y': pose[4], 'z': pose[5], 'w': pose[6]}}))
    else:
        print('client is not connected')

def plane_to_pose(frame_origin, frame):

    matrix = rg.Transform.PlaneToPlane(frame_origin, frame).Transpose()
    trace = matrix.M00 + matrix.M11 + matrix.M22

    q = rg.Quaternion()

    if trace > 0.0:
        s = math.sqrt(trace + 1.0)
        q.A = s * 0.5
        s = 0.5 / s
        q.B = (matrix.M12 - matrix.M21) * s
        q.C = (matrix.M20 - matrix.M02) * s
        q.D = (matrix.M01 - matrix.M10) * s
    else:
        if matrix.M00 >= matrix.M11 and matrix.M00 >= matrix.M22:
            s = math.sqrt(1.0 + matrix.M00 - matrix.M11 - matrix.M22)
            inv_s = 0.5 / s
            q.B = 0.5 * s
            q.C = (matrix.M01 + matrix.M10) * inv_s
            q.D = (matrix.M02 + matrix.M20) * inv_s
            q.A = (matrix.M12 - matrix.M21) * inv_s
        elif matrix.M11 > matrix.M22:
            s = math.sqrt(1.0 + matrix.M11 - matrix.M00 - matrix.M22)
            inv_s = 0.5 / s
            q.B = (matrix.M10 + matrix.M01) * inv_s
            q.C = 0.5 * s
            q.D = (matrix.M21 + matrix.M12) * inv_s
            q.A = (matrix.M20 - matrix.M02) * inv_s
        else:
            s = math.sqrt(1.0 + matrix.M22 - matrix.M00 - matrix.M11)
            inv_s = 0.5 / s
            q.B = (matrix.M20 + matrix.M02) * inv_s
            q.C = (matrix.M21 + matrix.M12) * inv_s
            q.D = 0.5 * s
            q.A = (matrix.M01 - matrix.M10) * inv_s

    return [frame.OriginX/1000, frame.OriginY/1000, frame.OriginZ/1000, q.A, q.B, q.C, q.D]

publish_pose(plane_to_pose(origin,plane))
# ---------- end publish_pose ----------

# ----
panel_2 = Panel(publish_pose)
panel_3 = Panel(publish_pose_array)
panel_4 = Panel(python_2.out)
